# Grasshopper definition to_json.gh (Grasshopper 1.0.8)

crv = Curve(<curve referenced from the Rhino model>)
crv_2 = Curve([<curve referenced from the Rhino model> x4])
py3 = Python3Script(geo=crv, output_path="/Users/harvest/Desktop/map1.json")  # -> out, a; inputs geo: list of Curve, output_path: String
# ---------- py3: Python ----------
import json
import Rhino.Geometry as rg


# =============================

def polyline_to_dict(curve):
    if isinstance(curve, rg.PolylineCurve):
        polyline = curve.ToPolyline()
        points = [[pt.X, pt.Y] for pt in polyline]
        closed = curve.IsClosed
        return {
            "type": "polyline",
            "points": points,
            "closed": closed
        }
    elif isinstance(curve, rg.Curve) and curve.IsPolyline():
        success, polyline = curve.TryGetPolyline()
        if success:
            points = [[pt.X, pt.Y] for pt in polyline]
            closed = polyline.IsClosed
            return {
                "type": "polyline",
                "points": points,
                "closed": closed
            }
    return None

# ========== 主逻辑 ==========

entities = []
all_points = []

for g in geo:
    poly_dict = polyline_to_dict(g)
    if poly_dict:
        entities.append(poly_dict)
        # 添加点用于计算包围盒
        all_points.extend([rg.Point3d(pt[0], pt[1], 0) for pt in poly_dict["points"]])

# 自动计算宽高（或默认）
if all_points:
    bbox = rg.BoundingBox(all_points)
    width = bbox.Max.X - bbox.Min.X
    height = bbox.Max.Y - bbox.Min.Y
else:
    width = 100
    height = 100

data = {
    "width": width,
    "height": height,
    "entities": entities
}

json_str = json.dumps(data, indent=2)

# ========== 写入文件 ==========
try:
    with open(output_path, 'w') as f:
        f.write(json_str)
    saved = True
except Exception as e:
    saved = False
    json_str = "Error saving file: " + str(e)
# ---------- end py3 ----------
py3_2 = Python3Script(geo=crv_2, output_path="/Users/harvest/Desktop/map1.json")  # -> out, a; inputs geo: list of Curve, output_path: String; same code as py3
